# Grasshopper definition GPTFinal.gh (Grasshopper 1.0.8)
# plug-ins: RhinoCodePluginGH, Human, LunchBox, Wombat

doc_units = DocumentUnits()
# Options
data_source = ValueList({"Geometric": 0, "Manual": 1}, selected="Geometric")
manual_input = Panel("""blah
blyh
blah""")
model_units_convert_to_m = Panel(doc_units)
units = ValueList({"Length": 0, "Area M2": 1, "Volume M3": 2, "Quantity": 3}, selected="Area M2")

# ----
# 1) Attributes chosen by me, done through template JSON file
# Input Geometry
geo = Geometry([<surface referenced from the Rhino model> x2])

# ----
# Attributes
# Attributes Extraction - Metadata
objatts = ObjectAttributes(ObjectOrAttributes=geo)  # -> Name, LayerName, simplify(LayerFullPath), Color, MaterialName, LinetypeName, GroupIndices, PlotWeight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
panel = Panel(objatts.LayerFullPath)
concat = Concatenate(FragmentA=objatts.UserDataKeys, FragmentC=": ", FragmentB=objatts.UserDataValues, FragmentD="; ")
split = TextSplit(Text=panel, Separators="\"::\"", SplitOptions=1)
item = ListItem(List=split, Index=1, Wrap=True)
item_2 = ListItem(List=split, Index=0, Wrap=True)
concat_2 = Concatenate(FragmentA="Category: ", FragmentB=item_2, FragmentC="; ")
concat_3 = Concatenate(FragmentA="Subcategory: ", FragmentB=item, FragmentC="; ")

# ----
# Attributes Extraction - Numerical
gate = StreamGate(Stream=geo, Gate=units)  # -> Target0, Target1, Target2, Target3
unit_options = Panel("""M
M2
M3
Units""")
volume = Volume(Geometry=gate.Target2)  # -> Volume, Centroid
area = Area(Geometry=gate.Target1)  # -> Area, Centroid
len = Length(Curve=gate.Target0)
item_3 = ListItem(List=unit_options, Index=units, Wrap=True)
division = Division(A=len, B=1000)
division_2 = Division(A=area.Area, B=1000000)
division_3 = Division(A=volume.Volume, B=1000000000)
concat_4 = Concatenate(FragmentA=[division, division_2, division_3], FragmentB=" (", FragmentC=item_3, FragmentD=");")
or = GateOr()
entwine = Entwine(Branch00=concat_4, Branch01=manual_input, FlattenInputs=True)  # -> simplify(Result)
branch = TreeBranch(Tree=entwine, Path=data_source, MaintainPaths=True)  # -> graft(Branch)

relay = Relay([concat_2, concat_3, concat, branch])
# Enable these two components for them to run
join = TextJoin(Text=relay)
panel_2 = Panel(join)

embeddings_csv_path_seperated = Panel("User File path\\embeddings.csv")
# Cosine Similarity
py3 = Python3Script(prompt_string=join, csv_path=embeddings_csv_path_seperated)  # -> out, formatted_prompt, elapsed_time; disabled
# ---------- py3: Python ----------
import pandas as pd
import numpy as np
import time
from sklearn.metrics.pairwise import cosine_similarity
import re
start_time = time.time()
# Load the CSV file
#enter csv path under variable csv_path
df = pd.read_csv(csv_path)

# Convert embeddings from strings to lists of floats
df['embedding'] = df['embedding'].apply(lambda x: np.array(eval(x)))

# Convert the 'text' column to lowercase for easier case-insensitive matching
df['text'] = df['text'].str.lower()

# Function to get the top k similar words using cosine similarity
def find_similar_words(word, df, k=5):
    # Convert the input word to lowercase
    word = word.lower()
    
    # Get the embedding for the given word
    word_embedding = df.loc[df['text'] == word, 'embedding'].values
    if len(word_embedding) == 0:
        # If the word is not found, return an empty string or a default value
        return "N/A"
    
    word_embedding = word_embedding[0].reshape(1, -1)
    # Calculate cosine similarities between the given word and all other embeddings
    similarities = cosine_similarity(word_embedding, np.stack(df['embedding'].values))[0]
    
    # Add similarities to the dataframe
    df['similarity'] = similarities
    
    # Sort by similarity and get the top k results (excluding the word itself if present)
    top_k = df[df['text'] != word].nlargest(k, 'similarity')
    
    # Return the list of similar words as a comma-separated string
    return ', '.join(top_k['text'].values)

# Function to parse the text prompt into a dictionary
def parse_prompt(prompt_string):
    pattern = r"(\w+): ([^;]+)"
    matches = re.findall(pattern, prompt_string)
    return {key.strip(): value.strip() for key, value in matches}

# The input prompt as a text string
# Parse the text prompt into a dictionary
prompt = parse_prompt(prompt_string)

# Fields that we want to expand with similar words
fields_to_expand = ["Name", "Form", "Material"]

# Create the expanded prompt by incorporating similar words where applicable
expanded_prompt = {}
for key, value in prompt.items():
    if key in fields_to_expand:
        expanded_prompt[key] = f"{value} ({find_similar_words(value, df)})"
    else:
        expanded_prompt[key] = value

# Create the formatted prompt string
formatted_prompt = "; ".join([f"{key}: {value}" for key, value in expanded_prompt.items()]) + "."
end_time = time.time()
elapsed_time = end_time - start_time
# Print the formatted prompt
print(formatted_prompt)
# ---------- end py3 ----------

# ----
# Debug
original_prompt = Panel(py3.formatted_prompt)
expanded_prompt = Panel(py3.formatted_prompt)

# ----
# OpenAI API
api_key = Panel("INSERT YOUR API KEY HERE")
openai_api = Python3Script(api_key=api_key, GH_Message_Expanded=flatten(panel_2))  # -> out, runs, extracted_values, elapsed_time, system_status2, GH_IDs, GH_Names, GH_Categories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; disabled
# ---------- openai_api: Python ----------
# requirements: openai
# requirements: openai
import openai
from openai import OpenAI
import os
import time
import json
import re

# if sc.sticky.get('has_run'):
start_time = time.time()
# system_status2='running'
# indent this all if using the if statement


# requirements: openai
import scriptcontext as sc
import openai
from openai import OpenAI
import os
import time
import json
import re


class Assistant:
    def __init__(self, id):
        self.id = id

#Insert your Project Key Here#
api_key = api_key
def create_client():
    return OpenAI(api_key=api_key, project="###################################")


def retrieve_vector_store_file(client, vector_store_id, file_id):
    """
    Retrieve a specific file from a vector store and return the result.
    """
    return client.beta.vector_stores.files.retrieve(
        vector_store_id=vector_store_id, file_id=file_id
    )


def create_thread(client):
    """
    Create and return a new conversation thread.
    """
    return client.beta.threads.create()


def create_message(client, thread_id, role, content):
    """
    Create and send a message in a specific conversation thread.
    """
    return client.beta.threads.messages.create(
        thread_id=thread_id,
        role=role,
        content=content,
    )


def create_run(client, thread_id, assistant_id):
    """
    Create and return a run for a specific conversation thread and assistant.
    """
    return client.beta.threads.runs.create(
        thread_id=thread_id,
        assistant_id=assistant_id,
    )


def wait_on_run(client, run, thread_id):
    """
    Wait until the run has completed and return the updated run.
    """
    while run.status in ("queued", "in_progress"):
        run = client.beta.threads.runs.retrieve(
            thread_id=thread_id,
            run_id=run.id,
        )
        time.sleep(0.5)
    return run


def list_messages(client, thread_id):
    """
    List and return all messages from the specified conversation thread.
    """
    return client.beta.threads.messages.list(thread_id=thread_id)


def extraction(messages):
    """
    Extract and return the value of the 'content' key from an array of message dictionaries.
    """
    extracted_values = []
    for message in messages:
        if message.content and len(message.content) > 0:
            extracted_values.append(message.content[0].text.value)
    return extracted_values


# Main logic
if __name__ == "__main__":
    assistant = Assistant(id="asst_YuPpiIEWhmk9P8CMoY7b608i")
    client = create_client()

    # Step 1: Retrieve a file from a vector store
    vector_store_id = "vs_eFeppNouvUVvRhDeV2XcBEyB"
    file_id = "file-B1oVcRihKjxLT9bASKWS2sHz"
    vector_store_file = retrieve_vector_store_file(
        client, vector_store_id, file_id)
    print("Retrieved Vector Store File:", vector_store_file)

    # Step 2: Create a new thread
    thread = create_thread(client)

    # Step 3: Send a message to the thread
    create_message(
        client,
        thread_id=thread.id,
        role="user",
        content=GH_Message_Expanded,
    )

    # Step 4: Create a run to get a response from the assistant
    run = create_run(client, thread_id=thread.id, assistant_id=assistant.id)

    # Step 5: Wait for the run to complete
    run = wait_on_run(client, run, thread_id=thread.id)

    # Step 6: List all messages in the thread
    messages = list_messages(client, thread_id=thread.id)

    # Step 7: Extract and print only the message content value
    extracted_values = extraction(messages)
    for value in extracted_values:
        print("\n\n", value, "\n\n")

    # Other code for handling tool calls, parsing JSON, etc.

    # Step 7: Extract and print tool calls used by the assistant
    # Not sure if this works tbh?
    if hasattr(run, "tool_calls") and run.tool_calls:
        print("\nTool Calls Used by the Assistant:")
        for tool_call in run.tool_calls:
            print(f"Tool Name: {tool_call['function']}")
            print(f"Parameters: {tool_call['parameters']}")
            print(f"Response: {tool_call['response']}\n")

    # Print the final status of the run
    print("Run Status:", run.status)


# debug tools called
runs = client.beta.threads.runs.list(thread.id)
# This is the print of the run tools. Check to see if a tool was called
print(runs)

end_time = time.time()
elapsed_time = end_time - start_time


# sc.sticky['has_run'] = False
# print('has_run sticky has been set to:')
# print(sc.sticky['has_run'])


# else:
# system_status2='Waiting for prompt!'
# ---------- end openai_api ----------

word_embeddings_time = Panel(py3.elapsed_time)
openai_api_time = Panel(openai_api.elapsed_time)
addition = Addition(A=word_embeddings_time, B=openai_api_time)
total_time = Panel(addition)

debug_run_and_tool_call = Panel(openai_api.runs)
shell = Panel(openai_api.out)
gpt_response = Panel(openai_api.extracted_values)

# ----
# Extract Message from Json
lng = ListLength(List=flatten(openai_api.extracted_values))
division_4 = Division(A=lng, B=2)
series = Series(Start=0, Step=2, Count=flatten(division_4))
item_4 = ListItem(List=flatten(openai_api.extracted_values), Index=simplify(series), Wrap=True)  # -> simplify(Item)
py3_2 = Python3Script(x=item_4)  # -> out, simplify(a), simplify(b)
# ---------- py3_2: Python ----------
import json
import re
print(x)

def extract_json_blocks(text):
    """
    Extracts all JSON contents enclosed within ```json and ``` markers.
    Returns a list of JSON strings.
    """
    # Regular expression to find all JSON blocks
    json_pattern = r"```json\s*(.*?)\s*```"
    matches = re.findall(json_pattern, text, re.DOTALL | re.IGNORECASE)
    if matches:
        return matches  # Return all JSON blocks
    else:
        raise ValueError("No JSON block found in the input text.")

def parse_json(json_str):
    """
    Parses the JSON string into a Python list of dictionaries.
    """
    try:
        data = json.loads(json_str)
        return data
    except json.JSONDecodeError as e:
        raise ValueError(f"Invalid JSON format: {e}")

def extract_fields(data, id_key="ID", certainty_keys=["certainty_score", "Certainty Score", "Certainty"]):
    """
    Extracts 'ID' and 'certainty_score' from each dictionary in the data list.
    Handles different key naming conventions for 'certainty_score' in a case-insensitive manner.
    Passes the certainty_score values as strings, preserving any percentage signs.
    """
    ids = []
    certainty_scores = []
    
    # Convert certainty_keys to lowercase for case-insensitive matching
    certainty_keys_lower = [key.lower() for key in certainty_keys]
    id_key_lower = id_key.lower()
    
    for entry in data:
        # Create a lowercase key mapping for the current entry
        entry_keys_lower = {key.lower(): key for key in entry}
        
        # Extract ID with case-insensitive key matching
        id_value = None
        if id_key_lower in entry_keys_lower:
            id_value = entry[entry_keys_lower[id_key_lower]]
        ids.append(id_value)
        
        # Extract certainty_score with case-insensitive key matching
        cert_value = None
        for key_lower in certainty_keys_lower:
            if key_lower in entry_keys_lower:
                cert_value = entry[entry_keys_lower[key_lower]]
                break
        
        # Pass the certainty_score as a string (with or without '%')
        certainty_scores.append(str(cert_value) if cert_value is not None else None)
    
    return ids, certainty_scores

# --- Input Handling ---

# 'x' is the input parameter. It could be a single string or a list of strings.
# We'll ensure it's a single string by joining if it's a list.
if isinstance(x, list):
    input_text = "\n".join(x)
elif isinstance(x, str):
    input_text = x
else:
    input_text = str(x)  # Convert other types to string if possible

try:
    # Step 1: Extract all JSON blocks
    json_contents = extract_json_blocks(input_text)
    
    # Initialize lists to hold all IDs and certainty scores
    all_ids = []
    all_certainty_scores = []
    
    # Step 2: Parse each JSON block and extract fields
    for json_content in json_contents:
        parsed_data = parse_json(json_content)
        ids, certainty_scores = extract_fields(parsed_data)
        all_ids.extend(ids)
        all_certainty_scores.extend(certainty_scores)
    
    # Output the results
    a = all_ids  # List of IDs
    b = all_certainty_scores  # List of Certainty Scores

except ValueError as error:
    # Handle errors (e.g., no JSON found, invalid JSON)
    a = f"Error: {error}"
    b = None
# ---------- end py3_2 ----------
panel_3 = Panel(py3_2.a)
panel_4 = Panel(py3_2.b)

panel_5 = Panel(item_4)

# ----
# Save Test Data
# Make sure the file is closed!
toggle = BooleanToggle(False)
toggle_2 = BooleanToggle(False)
flip = FlipMatrix(Data=panel_4)  # -> simplify(Data)
flip_2 = FlipMatrix(Data=panel_3)  # -> simplify(Data)
panel_6 = Panel(flip_2)
panel_7 = Panel("""M#1 
M#2 
M#3 
M#4 
M#5 
M#6 
M#7 
M#8 
M#9  
M#10 """)
excelwrite = ExcelWrite(
    WriteExcelData=toggle,
    WorkbookPath="Excel File Path Here",
    WorksheetName="Output_Ids",
    ColumnHeadings=panel_7,
    Data=panel_6,
    ClearSheet=toggle_2)
excelwrite_2 = ExcelWrite(
    WriteExcelData=toggle,
    WorkbookPath="Excel File Path Here",
    WorksheetName="Output_Certainty",
    ColumnHeadings=panel_7,
    Data=flip,
    ClearSheet=toggle_2)
excelwrite_3 = ExcelWrite(
    WriteExcelData=toggle,
    WorkbookPath="Excel File Path Here",
    WorksheetName="Output_Ids_2",
    ColumnHeadings=panel_7,
    Data=panel_6,
    ClearSheet=toggle_2)
excelwrite_4 = ExcelWrite(
    WriteExcelData=toggle,
    WorkbookPath="Excel File Path Here",
    WorksheetName="Output_Certainty_2",
    ColumnHeadings=panel_7,
    Data=panel_6,
    ClearSheet=toggle_2)
