# Grasshopper definition GPTFinalTesting.gh (Grasshopper 1.0.8)
# plug-ins: RhinoCodePluginGH, LunchBox, Wombat

# Name: London brick cladding; Category: Walls; Subcategory: Common; Form: Block; Material: Clay
# Name: Double glazed window unit; Category: Windows; Subcategory: Common; Form: Window; Material: Glass
# Name: Double glazed window unit; Category: Windows; Subcategory: Common; Form: Window; Material: Glass
panel = Panel("""Name: London brick cladding; Category: Walls; Subcategory: Common; Form: Block; Material: Clay
Name: Double glazed window unit; Category: Windows; Subcategory: Common; Form: Window; Material: Glass
Name: Wooden floor tiles; Category: Floors; Subcategory: Finish; Form: Tile; Material: Beech
Name: Corten Steel Handrail; Category: Railings; Subcategory: Handrail; Form: Plank; Material: Stainless Steel
Name: Stone gabions; Category: Site; Subcategory: Site Component; Form: Block; Material: Steel mesh and stone
Name: UPVC soffit; Category: Roof; Subcategory: nan; Form: Sheet; Material: UPVC
Name: reinforced concrete beam; Category: Structural Framing; Subcategory: Beam; Form: Beam; Material: RC
Name: Steel joist; Category: Structural Framing; Subcategory: Beam; Form: Beam; Material: Steel
Name: Stair Balustrade; Category: Stairs; Subcategory: nan; Form: Plank; Material: Hardwood
Name: Workspace Countertop; Category: Casework; Subcategory: nan; Form: Sheet; Material: Corian
Name: Ornate Lintel; Category: Structural Framing; Subcategory: Beam; Form: Beam; Material: Sandstone
Name: Door Threshold Strip; Category: Doors; Subcategory: nan; Form: Plank; Material: Brass
Name: Bathroom Towel Radiator; Category: Plumbing Fixtures; Subcategory: nan; Form: Radiator; Material: Chrome
Name: Steel Frame System; Category: Structural Framing; Subcategory: nan; Form: Steel Sections; Material: Steel
Name: GRC Cladding Panel; Category: Walls; Subcategory: Common; Form: Sheet; Material: GRC
Name: Copper Door Handle; Category: Doors; Subcategory: nan; Form: Handle; Material: Copper
Name: Weathered shading Louvres; Category: Roofs; Subcategory: nan; Form: Plank; Material: Ekki
Name: Towel Rail; Category: Railings; Subcategory: Handrail; Form: Pipe; Material: Copper
Name: Perforated Ceiling Panel; Category: Ceilings; Subcategory: Common; Form: Sheet; Material: Stainless Steel
Name: Backsplash Tiles; Category: Walls; Subcategory: Interior; Form: nan; Material: Ceramic
Name: Painted door surounds; Category: Doors; Subcategory: nan; Form: Plank; Material: MDF
Name: Staircase; Category: Stairs; Subcategory: Treads; Form: Plank; Material: Oak
Name: Slate Roof; Category: Roofs; Subcategory: nan; Form: Tile; Material: Slate
Name: Ashlar Masonry; Category: Walls; Subcategory: Exterior; Form: Block; Material: Flint
Name: Toilet; Category: Plumbing Fixtures; Subcategory: nan; Form: Toilet; Material: Ceramic
Name: Steel roof sheet; Category: Roofs; Subcategory: nan; Form: Sheet; Material: Steel
Name: 2x4; Category: Structural Framing; Subcategory: nan; Form: Plank; Material: Pine
Name: Noggin; Category: Structural Framing; Subcategory: nan; Form: Plank; Material: Softwood
Name: Shower tray; Category: Plumbing Fixtures; Subcategory: nan; Form: Tray; Material: Plastic
Name: Shelving; Category: Casework; Subcategory: nan; Form: Sheet; Material: Veneer""")

embeddings_csv_path_seperated = Panel("User file path\\embeddings.csv")
# Cosine Similarity
py3 = Python3Script(prompt_string=panel, csv_path=embeddings_csv_path_seperated)  # -> out, formatted_prompt, elapsed_time; disabled
# ---------- py3: Python ----------
import pandas as pd
import numpy as np
import time
from sklearn.metrics.pairwise import cosine_similarity
import re
start_time = time.time()
# Load the CSV file
#enter csv path under variable csv_path
df = pd.read_csv(csv_path)

# Convert embeddings from strings to lists of floats
df['embedding'] = df['embedding'].apply(lambda x: np.array(eval(x)))

# Convert the 'text' column to lowercase for easier case-insensitive matching
df['text'] = df['text'].str.lower()

# Function to get the top k similar words using cosine similarity
def find_similar_words(word, df, k=5):
    # Convert the input word to lowercase
    word = word.lower()
    
    # Get the embedding for the given word
    word_embedding = df.loc[df['text'] == word, 'embedding'].values
    if len(word_embedding) == 0:
        # If the word is not found, return an empty string or a default value
        return "N/A"
    
    word_embedding = word_embedding[0].reshape(1, -1)
    # Calculate cosine similarities between the given word and all other embeddings
    similarities = cosine_similarity(word_embedding, np.stack(df['embedding'].values))[0]
    
    # Add similarities to the dataframe
    df['similarity'] = similarities
    
    # Sort by similarity and get the top k results (excluding the word itself if present)
    top_k = df[df['text'] != word].nlargest(k, 'similarity')
    
    # Return the list of similar words as a comma-separated string
    return ', '.join(top_k['text'].values)

# Function to parse the text prompt into a dictionary
def parse_prompt(prompt_string):
    pattern = r"(\w+): ([^;]+)"
    matches = re.findall(pattern, prompt_string)
    return {key.strip(): value.strip() for key, value in matches}

# The input prompt as a text string
# Parse the text prompt into a dictionary
prompt = parse_prompt(prompt_string)

# Fields that we want to expand with similar words
fields_to_expand = ["Name", "Form", "Material"]

# Create the expanded prompt by incorporating similar words where applicable
expanded_prompt = {}
for key, value in prompt.items():
    if key in fields_to_expand:
        expanded_prompt[key] = f"{value} ({find_similar_words(value, df)})"
    else:
        expanded_prompt[key] = value

# Create the formatted prompt string
formatted_prompt = "; ".join([f"{key}: {value}" for key, value in expanded_prompt.items()]) + "."
end_time = time.time()
elapsed_time = end_time - start_time
# Print the formatted prompt
print(formatted_prompt)
# ---------- end py3 ----------

# ----
# Debug
original_prompt = Panel(py3.formatted_prompt)
expanded_prompt = Panel(py3.formatted_prompt)

# ----
# OpenAI API
api_key = Panel("INSERT API KEY")
openai_api = Python3Script(api_key=api_key, GH_Message_Expanded=py3.formatted_prompt)  # -> out, runs, extracted_values, elapsed_time, system_status2, GH_IDs, GH_Names, GH_Categories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; disabled
# ---------- openai_api: Python ----------
# requirements: openai
# requirements: openai
import openai
from openai import OpenAI
import os
import time
import json
import re

# if sc.sticky.get('has_run'):
start_time = time.time()
# system_status2='running'
# indent this all if using the if statement


# requirements: openai
import scriptcontext as sc
import openai
from openai import OpenAI
import os
import time
import json
import re


class Assistant:
    def __init__(self, id):
        self.id = id
#Insert project key here#
api_key = api_key
def create_client():
    return OpenAI(api_key=api_key, project="##########################")


def retrieve_vector_store_file(client, vector_store_id, file_id):
    """
    Retrieve a specific file from a vector store and return the result.
    """
    return client.beta.vector_stores.files.retrieve(
        vector_store_id=vector_store_id, file_id=file_id
    )


def create_thread(client):
    """
    Create and return a new conversation thread.
    """
    return client.beta.threads.create()


def create_message(client, thread_id, role, content):
    """
    Create and send a message in a specific conversation thread.
    """
    return client.beta.threads.messages.create(
        thread_id=thread_id,
        role=role,
        content=content,
    )


def create_run(client, thread_id, assistant_id):
    """
    Create and return a run for a specific conversation thread and assistant.
    """
    return client.beta.threads.runs.create(
        thread_id=thread_id,
        assistant_id=assistant_id,
    )


def wait_on_run(client, run, thread_id):
    """
    Wait until the run has completed and return the updated run.
    """
    while run.status in ("queued", "in_progress"):
        run = client.beta.threads.runs.retrieve(
            thread_id=thread_id,
            run_id=run.id,
        )
        time.sleep(0.5)
    return run


def list_messages(client, thread_id):
    """
    List and return all messages from the specified conversation thread.
    """
    return client.beta.threads.messages.list(thread_id=thread_id)


def extraction(messages):
    """
    Extract and return the value of the 'content' key from an array of message dictionaries.
    """
    extracted_values = []
    for message in messages:
        if message.content and len(message.content) > 0:
            extracted_values.append(message.content[0].text.value)
    return extracted_values


# Main logic
if __name__ == "__main__":
    assistant = Assistant(id="asst_YuPpiIEWhmk9P8CMoY7b608i")
    client = create_client()

    # Step 1: Retrieve a file from a vector store
    vector_store_id = "vs_eFeppNouvUVvRhDeV2XcBEyB"
    file_id = "file-B1oVcRihKjxLT9bASKWS2sHz"
    vector_store_file = retrieve_vector_store_file(
        client, vector_store_id, file_id)
    print("Retrieved Vector Store File:", vector_store_file)

    # Step 2: Create a new thread
    thread = create_thread(client)

    # Step 3: Send a message to the thread
    create_message(
        client,
        thread_id=thread.id,
        role="user",
        content=GH_Message_Expanded,
    )

    # Step 4: Create a run to get a response from the assistant
    run = create_run(client, thread_id=thread.id, assistant_id=assistant.id)

    # Step 5: Wait for the run to complete
    run = wait_on_run(client, run, thread_id=thread.id)

    # Step 6: List all messages in the thread
    messages = list_messages(client, thread_id=thread.id)

    # Step 7: Extract and print only the message content value
    extracted_values = extraction(messages)
    for value in extracted_values:
        print("\n\n", value, "\n\n")

    # Other code for handling tool calls, parsing JSON, etc.

    # Step 7: Extract and print tool calls used by the assistant
    # Not sure if this works tbh?
    if hasattr(run, "tool_calls") and run.tool_calls:
        print("\nTool Calls Used by the Assistant:")
        for tool_call in run.tool_calls:
            print(f"Tool Name: {tool_call['function']}")
            print(f"Parameters: {tool_call['parameters']}")
            print(f"Response: {tool_call['response']}\n")

    # Print the final status of the run
    print("Run Status:", run.status)


# debug tools called
runs = client.beta.threads.runs.list(thread.id)
# This is the print of the run tools. Check to see if a tool was called
print(runs)

end_time = time.time()
elapsed_time = end_time - start_time


# sc.sticky['has_run'] = False
# print('has_run sticky has been set to:')
# print(sc.sticky['has_run'])


# else:
# system_status2='Waiting for prompt!'
# ---------- end openai_api ----------

# ----
# OpenAI API
# Cosine Similarity
api_key_2 = Panel("INSERT API KEY")
openai_api_2 = Python3Script(api_key=api_key_2, GH_Message_Expanded=panel)  # -> out, runs, extracted_values, elapsed_time, system_status2, GH_IDs, GH_Names, GH_Categories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; disabled
# ---------- openai_api_2: Python ----------
# requirements: openai
# requirements: openai
import openai
from openai import OpenAI
import os
import time
import json
import re

# if sc.sticky.get('has_run'):
start_time = time.time()
# system_status2='running'
# indent this all if using the if statement


# requirements: openai
import scriptcontext as sc
import openai
from openai import OpenAI
import os
import time
import json
import re


class Assistant:
    def __init__(self, id):
        self.id = id

#Insert project key here#
api_key = api_key
def create_client():
    return OpenAI(api_key=api_key, project="##########################")


def retrieve_vector_store_file(client, vector_store_id, file_id):
    """
    Retrieve a specific file from a vector store and return the result.
    """
    return client.beta.vector_stores.files.retrieve(
        vector_store_id=vector_store_id, file_id=file_id
    )


def create_thread(client):
    """
    Create and return a new conversation thread.
    """
    return client.beta.threads.create()


def create_message(client, thread_id, role, content):
    """
    Create and send a message in a specific conversation thread.
    """
    return client.beta.threads.messages.create(
        thread_id=thread_id,
        role=role,
        content=content,
    )


def create_run(client, thread_id, assistant_id):
    """
    Create and return a run for a specific conversation thread and assistant.
    """
    return client.beta.threads.runs.create(
        thread_id=thread_id,
        assistant_id=assistant_id,
    )


def wait_on_run(client, run, thread_id):
    """
    Wait until the run has completed and return the updated run.
    """
    while run.status in ("queued", "in_progress"):
        run = client.beta.threads.runs.retrieve(
            thread_id=thread_id,
            run_id=run.id,
        )
        time.sleep(0.5)
    return run


def list_messages(client, thread_id):
    """
    List and return all messages from the specified conversation thread.
    """
    return client.beta.threads.messages.list(thread_id=thread_id)


def extraction(messages):
    """
    Extract and return the value of the 'content' key from an array of message dictionaries.
    """
    extracted_values = []
    for message in messages:
        if message.content and len(message.content) > 0:
            extracted_values.append(message.content[0].text.value)
    return extracted_values


# Main logic
if __name__ == "__main__":
    assistant = Assistant(id="asst_YuPpiIEWhmk9P8CMoY7b608i")
    client = create_client()

    # Step 1: Retrieve a file from a vector store
    vector_store_id = "vs_eFeppNouvUVvRhDeV2XcBEyB"
    file_id = "file-B1oVcRihKjxLT9bASKWS2sHz"
    vector_store_file = retrieve_vector_store_file(
        client, vector_store_id, file_id)
    print("Retrieved Vector Store File:", vector_store_file)

    # Step 2: Create a new thread
    thread = create_thread(client)

    # Step 3: Send a message to the thread
    create_message(
        client,
        thread_id=thread.id,
        role="user",
        content=GH_Message_Expanded,
    )

    # Step 4: Create a run to get a response from the assistant
    run = create_run(client, thread_id=thread.id, assistant_id=assistant.id)

    # Step 5: Wait for the run to complete
    run = wait_on_run(client, run, thread_id=thread.id)

    # Step 6: List all messages in the thread
    messages = list_messages(client, thread_id=thread.id)

    # Step 7: Extract and print only the message content value
    extracted_values = extraction(messages)
    for value in extracted_values:
        print("\n\n", value, "\n\n")

    # Other code for handling tool calls, parsing JSON, etc.

    # Step 7: Extract and print tool calls used by the assistant
    # Not sure if this works tbh?
    if hasattr(run, "tool_calls") and run.tool_calls:
        print("\nTool Calls Used by the Assistant:")
        for tool_call in run.tool_calls:
            print(f"Tool Name: {tool_call['function']}")
            print(f"Parameters: {tool_call['parameters']}")
            print(f"Response: {tool_call['response']}\n")

    # Print the final status of the run
    print("Run Status:", run.status)


# debug tools called
runs = client.beta.threads.runs.list(thread.id)
# This is the print of the run tools. Check to see if a tool was called
print(runs)

end_time = time.time()
elapsed_time = end_time - start_time


# sc.sticky['has_run'] = False
# print('has_run sticky has been set to:')
# print(sc.sticky['has_run'])


# else:
# system_status2='Waiting for prompt!'
# ---------- end openai_api_2 ----------

word_embeddings_time = Panel(py3.elapsed_time)
openai_api_time = Panel(openai_api.elapsed_time)
addition = Addition(A=word_embeddings_time, B=openai_api_time)
total_time = Panel(addition)

debug_run_and_tool_call = Panel(openai_api.runs)
shell = Panel(openai_api.out)
gpt_response = Panel(openai_api.extracted_values)

lng = ListLength(List=flatten(openai_api.extracted_values))
division = Division(A=lng, B=2)
series = Series(Start=0, Step=2, Count=flatten(division))
item = ListItem(List=flatten(openai_api.extracted_values), Index=flatten(series), Wrap=True)  # -> flatten(Item)
py3_2 = Python3Script(x=item)  # -> out, simplify(a), simplify(b)
# ---------- py3_2: Python ----------
import json
import re
print(x)
def extract_json_block(text):
    """
    Extracts JSON content enclosed within ```json and ``` markers.
    """
    # Regular expression to find the JSON block
    json_pattern = r"```json\s*(.*?)\s*```"
    matches = re.findall(json_pattern, text, re.DOTALL | re.IGNORECASE)
    if matches:
        return matches[0]  # Assuming there's only one JSON block
    else:
        raise ValueError("No JSON block found in the input text.")

def parse_json(json_str):
    """
    Parses the JSON string into a Python list of dictionaries.
    """
    try:
        data = json.loads(json_str)
        return data
    except json.JSONDecodeError as e:
        raise ValueError(f"Invalid JSON format: {e}")

def extract_fields(data, id_key="ID", certainty_keys=["certainty_score", "Certainty Score", "Certainty", "certainty", "certainty score", "certainty value", "Certainty Value", "Score", "score", "CertaintyScore"]):
    """
    Extracts 'ID' and 'certainty_score' from each dictionary in the data list.
    Handles different key naming conventions for 'certainty_score'.
    Cleans the certainty_score values by removing any non-digit characters.
    """
    ids = []
    certainty_scores = []
    
    for entry in data:
        # Extract ID
        id_value = entry.get(id_key)
        if id_value is not None:
            ids.append(id_value)
        else:
            ids.append(None)  # Placeholder if ID is missing
        
        # Extract certainty_score with possible key variations
        cert_value = None
        for key in certainty_keys:
            if key in entry:
                cert_value = entry[key]
                break
        
        # Clean the certainty_score (remove '%' if present and convert to integer)
        if cert_value is not None:
            # Use regex to extract numeric part
            match = re.search(r'\d+', str(cert_value))
            if match:
                cert_value_clean = match.group()
                certainty_scores.append(cert_value_clean)
            else:
                certainty_scores.append(None)
        else:
            certainty_scores.append(None)
    
    return ids, certainty_scores

# --- Input Handling ---

# 'x' is the input parameter. It could be a single string or a list of strings.
# We'll ensure it's a single string by joining if it's a list.
if isinstance(x, list):
    input_text = "\n".join(x)
elif isinstance(x, str):
    input_text = x
else:
    input_text = str(x)  # Convert other types to string if possible

try:
    # Step 1: Extract JSON block
    json_content = extract_json_block(input_text)
    
    # Step 2: Parse JSON
    parsed_data = parse_json(json_content)
    
    # Step 3: Extract 'ID' and 'certainty_score'
    ids, certainty_scores = extract_fields(parsed_data)
    
    # Output the results
    a = ids  # List of IDs
    b = certainty_scores  # List of Certainty Scores

except ValueError as error:
    # Handle errors (e.g., no JSON found, invalid JSON)
    a = f"Error: {error}"
    b = None
# ---------- end py3_2 ----------
panel_2 = Panel(py3_2.a)
panel_3 = Panel(py3_2.b)

# ----
# Extract Message from Json
lng_2 = ListLength(List=flatten(openai_api_2.extracted_values))
division_2 = Division(A=lng_2, B=2)
series_2 = Series(Start=0, Step=2, Count=flatten(division_2))
item_2 = ListItem(List=flatten(openai_api_2.extracted_values), Index=flatten(series_2), Wrap=True)  # -> flatten(Item)
py3_3 = Python3Script(x=item_2)  # -> out, simplify(a), simplify(b); same code as py3_2
panel_4 = Panel(py3_3.a)
panel_5 = Panel(py3_3.b)

# ----
# Extract Message from Json
panel_6 = Panel(openai_api_2.extracted_values)
flip = FlipMatrix(Data=panel_5)  # -> simplify(Data)
flip_2 = FlipMatrix(Data=panel_4)  # -> simplify(Data)

flip_3 = FlipMatrix(Data=panel_2)  # -> simplify(Data)
flip_4 = FlipMatrix(Data=panel_3)  # -> simplify(Data)

# ----
# Make sure the file is closed!
panel_7 = Panel("\"Excel File Path\"")
toggle = BooleanToggle(False)
panel_8 = Panel("""M#1 
M#2 
M#3 
M#4 
M#5 
M#6 
M#7 
M#8 
M#9  
M#10 """)

null = NullObject()
null_2 = NullItem()  # -> NullFlags, InvalidFlags, Description

# ----
# Save Test Data
panel_9 = Panel(flip)
panel_10 = Panel(flip_2)

nullrep = ReplaceNulls(Items=panel_10, Replacements=0)  # -> Items, Count
nullrep_2 = ReplaceNulls(Items=panel_9, Replacements=0)  # -> Items, Count

excelwrite = ExcelWrite(
    WriteExcelData=Toggle(False),
    WorkbookPath=panel_7,
    WorksheetName="Output_Ids_2",
    ColumnHeadings=panel_8,
    Data=nullrep.Items,
    ClearSheet=toggle)
excelwrite_2 = ExcelWrite(
    WriteExcelData=Toggle(False),
    WorkbookPath=panel_7,
    WorksheetName="Output_Certainty_2",
    ColumnHeadings=panel_8,
    Data=nullrep_2.Items,
    ClearSheet=toggle)

panel_11 = Panel(flip_3)
panel_12 = Panel(flip_4)

nullrep_3 = ReplaceNulls(Items=panel_12, Replacements=0)  # -> Items, Count
nullrep_4 = ReplaceNulls(Items=panel_11, Replacements=0)  # -> Items, Count

excelwrite_3 = ExcelWrite(
    WriteExcelData=Toggle(False),
    WorkbookPath=panel_7,
    WorksheetName="Output_Ids",
    ColumnHeadings=panel_8,
    Data=nullrep_4.Items,
    ClearSheet=toggle)
excelwrite_4 = ExcelWrite(
    WriteExcelData=Toggle(False),
    WorkbookPath=panel_7,
    WorksheetName="Output_Certainty",
    ColumnHeadings=panel_8,
    Data=nullrep_3.Items,
    ClearSheet=toggle)

panel_13 = Panel(nullrep_4.Items)
panel_14 = Panel(excelwrite_3)
